# Dynamo graph Beams-CAD to BIM-Haseeb.dyn "Beam Creations" (Dynamo 2.17.0.3472)
# packages: bimorphNodes 5.0.0, Orchid 216.3.0.5945, Genius Loci 2023.7.13, KYSUDO.com 21.0.8

select_cad_link = DSModelElementSelection()  # 1 picked in the model; graph input
beam_centre_line_layer_name = StringInput("Beam-CL")  # graph input
curvesFromCADLayers = CAD.CurvesFromCADLayers(importInstance=select_cad_link, layerNames=beam_centre_line_layer_name)
flatten = List.Flatten(list=curvesFromCADLayers.Curve)
level_to_place_beams = Levels("L2")  # graph input
reference_beam_type = StructuralFramingTypes("12 x 24")  # graph input
text_layer_name = StringInput("DONUT")  # graph input
fromLayers = CADTextData.FromLayers(importInstance=select_cad_link, layerNames=text_layer_name)
originPoint = CADTextData.OriginPoint(cADTextData=fromLayers.CADTextData)
X = Point.X(point=originPoint)
Y = Point.Y(point=originPoint)
Z = Point.Z(point=originPoint)
byCoordinates = Point.ByCoordinates(x=X, y=Y, z=Z)
flatten_2 = List.Flatten(list=byCoordinates)
textValue = CADTextData.TextValue(cADTextData=fromLayers.CADTextData)
flatten_3 = List.Flatten(list=textValue)
nearest_Object = Custom[Nearest_Object](Geometrys=flatten, Others_Geometrys=flatten_2, objects=flatten_3)  # package KYSUDO.com
element_duplicate = Custom[Element Duplicate](element=reference_beam_type, name=nearest_Object)  # package Genius Loci; Duplicates the given element (view, element type).
string = StringInput("b")
string_2 = StringInput("(")
split = Orchid.Common.String.Split(string=nearest_Object, separator=string_2)
code_block = CodeBlock { 1; }
getItemAtIndex = List.GetItemAtIndex(list=split@L2, index=code_block)
string_3 = StringInput(")")
split_2 = Orchid.Common.String.Split(string=getItemAtIndex, separator=string_3)
code_block_2 = CodeBlock { 0; }
getItemAtIndex_2 = List.GetItemAtIndex(list=split_2@L2, index=code_block_2)
string_4 = StringInput("\"")
split_3 = Orchid.Common.String.Split(string=getItemAtIndex_2, separator=string_4)
code_block_3 = CodeBlock { 0; }
getItemAtIndex_3 = List.GetItemAtIndex(list=split_3@L2, index=code_block_3)
toNumber = String.ToNumber(string=getItemAtIndex_3)
code_block_4 = CodeBlock(x=toNumber) { x/12; }
setParameterByName = Element.SetParameterByName(element=element_duplicate, parameterName=string, value=code_block_4)
string_5 = StringInput("h")
code_block_5 = CodeBlock { 1; }
getItemAtIndex_4 = List.GetItemAtIndex(list=split_3@L2, index=code_block_5)
string_6 = StringInput("x")
split_4 = Orchid.Common.String.Split(string=getItemAtIndex_4, separator=string_6)
code_block_6 = CodeBlock { 0; }
getItemAtIndex_5 = List.GetItemAtIndex(list=split_4@L2, index=code_block_6)
toNumber_2 = String.ToNumber(string=getItemAtIndex_5)
code_block_7 = CodeBlock(x=toNumber_2) { x/12; }
setParameterByName_2 = Element.SetParameterByName(element=setParameterByName, parameterName=string_5, value=code_block_7)
beamByCurve = StructuralFraming.BeamByCurve(curve=flatten, level=level_to_place_beams, structuralFramingType=setParameterByName_2)
