# Dynamo graph Columns-CAD to BIM-Haseeb.dyn "Column Creation-Finalized" (Dynamo 2.17.0.3472)
# packages: bimorphNodes 5.0.0, Genius Loci 2023.7.13, archi-lab.net 2023.213.1722, KYSUDO.com 21.0.8, Rhythm 2023.8.2, spring nodes 210.1.1

select_cad = DSModelElementSelection()  # 1 picked in the model; graph input
curvesFromCADLayers = CAD.CurvesFromCADLayers(importInstance=select_cad)
byKeysValues = DesignScript.Builtin.Dictionary.ByKeysValues(keys=curvesFromCADLayers.layerKeys, values=curvesFromCADLayers.Curve)
grid_layer_name = StringInput("GRID")

# group: Grid Creation
valueAtKey = DesignScript.Builtin.Dictionary.ValueAtKey(dictionary=byKeysValues, key=grid_layer_name)  # frozen
group_parallel_lines = Custom[Group Parallel Lines](lines=valueAtKey)  # package Genius Loci; Groups parallel lines or linear elements together.
code_block = CodeBlock { 0; }
getItemAtIndex = List.GetItemAtIndex(list=group_parallel_lines, index=code_block)
startPoint = Curve.StartPoint(curve=getItemAtIndex)
endPoint = Curve.EndPoint(curve=getItemAtIndex)
byStartPointEndPoint = Line.ByStartPointEndPoint(startPoint=startPoint, endPoint=endPoint)
byLine = Grid.ByLine(line=byStartPointEndPoint)  # frozen
flatten = List.Flatten(list=byLine)
string = StringInput("Name")
code_block_2 = CodeBlock { "A"; }
count = List.Count(list=byLine)
code_block_3 = CodeBlock { 1; }
sequence = Sequence(start=code_block_2, amount=count, step=code_block_3)
flatten_2 = List.Flatten(list=sequence)
string_from_object = FromObject(object=flatten_2)
setParameterByName = Element.SetParameterByName(element=flatten, parameterName=string, value=string_from_object)  # frozen
code_block_4 = CodeBlock { 1; }
getItemAtIndex_2 = List.GetItemAtIndex(list=group_parallel_lines, index=code_block_4)
startPoint_2 = Curve.StartPoint(curve=getItemAtIndex_2)
endPoint_2 = Curve.EndPoint(curve=getItemAtIndex_2)
byStartPointEndPoint_2 = Line.ByStartPointEndPoint(startPoint=startPoint_2, endPoint=endPoint_2)
byLine_2 = Grid.ByLine(line=byStartPointEndPoint_2)  # frozen
flatten_3 = List.Flatten(list=byLine_2)
string_2 = StringInput("Name")
code_block_5 = CodeBlock { 1; }
count_2 = List.Count(list=byLine_2)
code_block_6 = CodeBlock { 1; }
sequence_2 = Sequence(start=code_block_5, amount=count_2, step=code_block_6)
flatten_4 = List.Flatten(list=sequence_2)
string_from_object_2 = FromObject(object=flatten_4)
setParameterByName_2 = Element.SetParameterByName(element=flatten_3, parameterName=string_2, value=string_from_object_2)

structural_column_types = StructuralColumnTypes("12 x 18")  # graph input
columns_layer_name = StringInput("Columns")  # graph input
levels = Levels("L1")  # graph input

# group: Column Creation
valueAtKey_2 = DesignScript.Builtin.Dictionary.ValueAtKey(dictionary=byKeysValues, key=columns_layer_name)
group_curves = Custom[Group Curves](curves=valueAtKey_2)  # package archi-lab.net; This node will take any input of flat list of curves and group them into sublists containing "joinable" curves that is continous curves. They might form closed curves or open curves. Use PolyCurve.ByJoinedCurves to convert output groups of curves into single PolyCurves
byJoinedCurves = PolyCurve.ByJoinedCurves(curves=group_curves)
toColumnGeometry = Custom[ToColumnGeometry](polyCurve=byJoinedCurves)  # package KYSUDO.com
code_block_7 = CodeBlock(b=toColumnGeometry.b_length, h=toColumnGeometry.h_length) { "C"+b+"x"+h; }
ꟿ_elementtype_duplicate = Custom[ꟿ ElementType.Duplicate](elementType=structural_column_types, newName=code_block_7)  # package spring nodes; Create duplicate element types. If the type exists, it will be appended instead.
byPointAndLevel = FamilyInstance.ByPointAndLevel(familyType=ꟿ_elementtype_duplicate, point=toColumnGeometry.Ins_Point, level=levels)
XAxis = Vector.XAxis()
angleWithVector = Vector.AngleWithVector(vector=toColumnGeometry.Column_Direction, otherVector=XAxis)
setRotation = FamilyInstance.SetRotation(familyInstance=byPointAndLevel, degree=angleWithVector)
string_3 = StringInput("b")
ʳʰʸᵗʰᵐ_elements = Rhythm.Revit.Elements.Elements.SetParameterByNameTypeOrInstance(element=byPointAndLevel, parameterName=string_3, value=toColumnGeometry.b_length)
string_4 = StringInput("h")
ʳʰʸᵗʰᵐ_elements_2 = Rhythm.Revit.Elements.Elements.SetParameterByNameTypeOrInstance(element=ʳʰʸᵗʰᵐ_elements, parameterName=string_4, value=toColumnGeometry.h_length)
