# Dynamo graph Floor-CAD to BIM-Haseeb.dyn "Floor Creation" (Dynamo 2.17.0.3472)
# packages: bimorphNodes 5.0.0, archi-lab.net 2023.213.1722, Rhythm 2023.8.2, Genius Loci 2023.7.13, Clockwork for Dynamo 2.x 2.6.0

select_cad = DSModelElementSelection()  # 1 picked in the model; graph input
layer_name = StringInput("Raft")  # graph input
curvesFromCADLayers = CAD.CurvesFromCADLayers(importInstance=select_cad, layerNames=layer_name)
flatten = List.Flatten(list=curvesFromCADLayers.Curve)
group_curves = Custom[Group Curves](curves=flatten)  # package archi-lab.net; This node will take any input of flat list of curves and group them into sublists containing "joinable" curves that is continous curves. They might form closed curves or open curves. Use PolyCurve.ByJoinedCurves to convert output groups of curves into single PolyCurves
byJoinedCurves = PolyCurve.ByJoinedCurves(curves=group_curves)
XY = Plane.XY()
pullOntoPlane = Curve.PullOntoPlane(curve=byJoinedCurves, plane=XY)
explode = Geometry.Explode(geometry=pullOntoPlane)
floor_types = FloorTypes("Conc 10")  # graph input
floor_name = StringInput("Raft")  # graph input
element_duplicate = Custom[Element Duplicate](element=floor_types, name=floor_name)  # package Genius Loci; Duplicates the given element (view, element type).
code_block = CodeBlock { 0; }
floor_thickness = DoubleInput(2)  # graph input
setCompoundLayerWidth = Custom[FamilyType.SetCompoundLayerWidth](familyType=element_duplicate, layerIndex=code_block, width=floor_thickness)  # package Clockwork for Dynamo 2.x; Sets the width of a specified compound layer of a given family type (only applies to family types that have a compound structure, e.g. walls, floors etc.).
levels = Levels("L1")  # graph input
ʳʰʸᵗʰᵐ_floor_bycurveloops = Rhythm.Revit.Elements.Floor.ByCurveLoops(curves=explode, floorType=setCompoundLayerWidth.familyType, level=levels)
