# Dynamo graph Walls-CAD to BIM-Haseeb.dyn (Dynamo 2.17.0.3472)
# packages: bimorphNodes 5.0.0, Chynamo 0.8.5, spring nodes 210.1.1, Orchid 216.3.0.5945, Clockwork for Dynamo 2.x 2.6.0, Genius Loci 2023.7.13

select_cad = DSModelElementSelection()  # 1 picked in the model; graph input
curvesFromCADLayers = CAD.CurvesFromCADLayers(importInstance=select_cad)
byKeysValues = DesignScript.Builtin.Dictionary.ByKeysValues(keys=curvesFromCADLayers.layerKeys, values=curvesFromCADLayers.Curve)
layer_name = StringInput("Walls")  # graph input
valueAtKey = DesignScript.Builtin.Dictionary.ValueAtKey(dictionary=byKeysValues, key=layer_name)
length = Curve.Length(curve=valueAtKey)
code_block = CodeBlock { 1; }
gt = length > code_block
filterByBoolMask = List.FilterByBoolMask(list=valueAtKey, mask=gt)
groupByParallel = Custom[GroupByParallel](lines=filterByBoolMask.in)  # package Chynamo; Group lines if they are parallel
max_wall_width = DoubleInput(2)  # graph input
ꟿ_geometry_groupbydistance = Custom[ꟿ Geometry.GroupByDistance](geometry=groupByParallel@@L2, margin=max_wall_width)  # package spring nodes; Splits the list of geometry elements into groups if the distance between them is less than the provided margin.
count = List.Count(list=ꟿ_geometry_groupbydistance@@L2)
code_block_2 = CodeBlock { 1; }
gt_2 = count > code_block_2
filterByBoolMask_2 = List.FilterByBoolMask(list=ꟿ_geometry_groupbydistance, mask=gt_2)
byGeometry = BoundingBox.ByGeometry(geom=filterByBoolMask_2.in)
ꟿ_boundingbox_2drectangle = Custom[ꟿ BoundingBox.2dRectangle](boundingBox=byGeometry)  # package spring nodes; Returns a 2d rectangle from a bounding box
corners = Polygon.Corners(polygon=ꟿ_boundingbox_2drectangle)
byPerimeterPoints = Surface.ByPerimeterPoints(points=corners)
code_block_3 = CodeBlock { 0.5; 0; 1; }
getIsoline = Surface.GetIsoline(surface=byPerimeterPoints, isoDirection=code_block_3.out0, parameter=code_block_3.out0)
length_2 = Curve.Length(curve=getIsoline)
getIsoline_2 = Surface.GetIsoline(surface=byPerimeterPoints, isoDirection=code_block_3.out1, parameter=code_block_3.out0)
length_3 = Curve.Length(curve=getIsoline_2)
gt_3 = length_2 > length_3
filterByBoolMask_3 = List.FilterByBoolMask(list=getIsoline, mask=gt_3)
filterByBoolMask_4 = List.FilterByBoolMask(list=getIsoline_2, mask=gt_3)
list_create = List.Create(item0=filterByBoolMask_3.in, item1=filterByBoolMask_4.out)
flatten = List.Flatten(list=list_create)
list_create_2 = List.Create(item0=filterByBoolMask_3.out, item1=filterByBoolMask_4.in)
flatten_2 = List.Flatten(list=list_create_2)
length_4 = Curve.Length(curve=flatten_2)
groupByKey = List.GroupByKey(list=flatten, keys=length_4)
top_level = Levels("L2")  # graph input
getElevation = Orchid.RevitProject.Datums.Level.GetElevation(level=top_level)
base_level = Levels("L1")  # graph input
getElevation_2 = Orchid.RevitProject.Datums.Level.GetElevation(level=base_level)
sub = getElevation - getElevation_2
wall_types = WallTypes("Concrete 18\"")  # graph input
uniqueItems = List.UniqueItems(list=length_4)
code_block_4 = CodeBlock(L=uniqueItems) { "Wall Width"+L; }
element_duplicate = Custom[Element Duplicate](element=wall_types, name=code_block_4)  # package Genius Loci; Duplicates the given element (view, element type).
code_block_5 = CodeBlock { 0; }
setCompoundLayerWidth = Custom[FamilyType.SetCompoundLayerWidth](familyType=element_duplicate, layerIndex=code_block_5, width=uniqueItems)  # package Clockwork for Dynamo 2.x; Sets the width of a specified compound layer of a given family type (only applies to family types that have a compound structure, e.g. walls, floors etc.).
byCurveAndHeight = Wall.ByCurveAndHeight(curve=groupByKey.groups, height=sub, level=base_level, wallType=setCompoundLayerWidth.familyType, lacing=Longest)
